# Grasshopper definition og-dodecohedron-gs.gh (Grasshopper 0.9.76)

# ---- group: pentagon
notch_geometry = Curve(<curve referenced from the Rhino model>)
input_shape = Curve(<curve referenced from the Rhino model>)
bbox = BoundingBox(Content=notch_geometry, Plane=PlaneXY(0, 0, 0))  # -> Box, Box_2
debrep = DeconstructBrep(Brep=bbox.Box)  # -> Faces, Edges, Vertices
evalsrf = EvaluateSurface(Surface=reparameterize(debrep.Faces), Point="{0.0, 0.5, 0.0}")  # -> Point, Normal, Frame
explode = Explode(Curve=input_shape, Recursive=True)  # -> Segments, Vertices
bbox_2 = BoundingBox(Content=input_shape, Plane=PlaneXY(0, 0, 0))  # -> Box, Box_2
hframe = HorizontalFrame(Curve=reparameterize(explode.Segments), Parameter=Slider(0.5, range=0..1))
prot = RotatePlane(Plane=hframe, Angle=1.570796327)
orient = Orient(Geometry=notch_geometry, Source=evalsrf.Frame, Target=graft(prot))  # -> flatten(Geometry), Transform
rdiff = RegionDifference(CurvesA=input_shape, CurvesB=orient.Geometry)
arrrec = RectangularArray(Geometry=rdiff, Cell=bbox_2.Box, XCount=Slider(3, range=0..10), YCount=Slider(4, range=0..10))  # -> Geometry, Transform

# ----
panel = Panel("""0.0
116.56505
180.0
296.56505""")
division = Division(A=panel, B=360)

# ---- group: Circle / circle
notch_geometry_2 = Curve(<curve referenced from the Rhino model>)
bbox_3 = BoundingBox(Content=notch_geometry_2, Plane=PlaneXY(0, 0, 0))  # -> Box, Box_2
debrep_2 = DeconstructBrep(Brep=bbox_3.Box)  # -> Faces, Edges, Vertices
evalsrf_2 = EvaluateSurface(Surface=reparameterize(debrep_2.Faces), Point="{0.0, 0.5, 0.0}")  # -> Point, Normal, Frame
cir = Circle(Plane=PlaneXY(0, 0, 0), Radius=Slider(20, range=0..100))
hframe_2 = HorizontalFrame(Curve=reparameterize(cir), Parameter=division)
crv = Curve(cir)
bbox_4 = BoundingBox(Content=cir, Plane=cir)  # -> Box, Box_2
prot_2 = RotatePlane(Plane=hframe_2, Angle=degrees(90))
orient_2 = Orient(Geometry=notch_geometry_2, Source=evalsrf_2.Frame, Target=graft(prot_2))  # -> flatten(Geometry), Transform
rdiff_2 = RegionDifference(CurvesA=crv, CurvesB=orient_2.Geometry)
arrrec_2 = RectangularArray(Geometry=rdiff_2, Cell=bbox_4.Box, XCount=Slider(5, range=0..10), YCount=Slider(5, range=0..10))  # -> Geometry, Transform
